# Dynamo graph set_comments_on_selection.dyn (Dynamo 4.0.2.3852)
# Set built-in instance Comments to PRUEBA_IA for the current selection. Test only on a disposable RVT.

python_script = Python()  # PythonNet3
# ---------- python_script.python (151 lines) ----------
import clr
import json
import os
clr.AddReference("RevitServices")
clr.AddReference("RevitAPI")
from RevitServices.Persistence import DocumentManager
from RevitServices.Transactions import TransactionManager
from Autodesk.Revit.DB import BuiltInParameter, StorageType

TARGET_VALUE = "PRUEBA_IA"


def is_disposable_test_document(doc):
    try:
        app_data = os.environ.get("APPDATA", "")
        settings_path = os.path.join(app_data, "BIM-AI-POC", "bridge.json")
        with open(settings_path, "r", encoding="utf-8") as settings_file:
            test_models_root = os.path.realpath(json.load(settings_file)["testModelsRoot"])
        model_path = os.path.realpath(doc.PathName)
        root = os.path.normcase(test_models_root)
        model = os.path.normcase(model_path)
        return (
            bool(model_path)
            and os.path.isfile(model_path)
            and os.path.splitext(model_path)[1].lower() == ".rvt"
            and os.path.commonpath([root, model]) == root
            and not doc.IsWorkshared
            and not doc.IsModified
            and not doc.IsModifiable
        )
    except (OSError, ValueError, KeyError, TypeError):
        return False


uiapp = DocumentManager.Instance.CurrentUIApplication
uidoc = uiapp.ActiveUIDocument if uiapp is not None else None

if uidoc is None or uidoc.Document is None:
    OUT = {"status": "no_active_document", "updated_ids": [], "unchanged_ids": [], "skipped": []}
else:
    doc = uidoc.Document
    if not is_disposable_test_document(doc):
        OUT = {"status": "test_model_required", "updated_ids": [], "unchanged_ids": [], "skipped": [], "affected_ids": []}
    elif doc.IsReadOnly:
        OUT = {"status": "document_read_only", "updated_ids": [], "unchanged_ids": [], "skipped": []}
    else:
        selected_ids = list(uidoc.Selection.GetElementIds())
        updated_ids = []
        unchanged_ids = []
        skipped = []
        writable = []

        for element_id in selected_ids:
            element = doc.GetElement(element_id)
            element_id_text = str(element_id.Value)
            if element is None:
                skipped.append({"id": element_id_text, "reason": "element_missing"})
                continue
            parameter = element.get_Parameter(BuiltInParameter.ALL_MODEL_INSTANCE_COMMENTS)
            if parameter is None:
                skipped.append({"id": element_id_text, "reason": "comments_unavailable"})
                continue
            if parameter.IsReadOnly or parameter.StorageType != StorageType.String:
                skipped.append({"id": element_id_text, "reason": "comments_not_writable_string"})
                continue
            previous_value = parameter.AsString()
            if previous_value == TARGET_VALUE:
                unchanged_ids.append(element_id_text)
            else:
                writable.append((element_id_text, parameter))

        if writable:
            TransactionManager.Instance.EnsureInTransaction(doc)
            try:
                for element_id_text, parameter in writable:
                    try:
                        if parameter.Set(TARGET_VALUE):
                            updated_ids.append(element_id_text)
                        else:
                            skipped.append({"id": element_id_text, "reason": "revit_rejected_value"})
                    except Exception:
                        skipped.append({"id": element_id_text, "reason": "parameter_set_failed"})
            finally:
                TransactionManager.Instance.TransactionTaskDone()

        OUT = {
            "status": "ok",
            "requested_value": TARGET_VALUE,
            "selected_count": len(selected_ids),
            "updated_ids": updated_ids,
            "unchanged_ids": unchanged_ids,
            "affected_ids": updated_ids,
            "skipped": skipped,
        }

# Appended verbatim after each generated routine's main script.
# Routines must return a JSON-compatible OUT value; the bridge reads this
# bounded result after Dynamo finishes and removes the per-run file.
import json as _bim_ai_json
import math as _bim_ai_math
import os as _bim_ai_os
import re as _bim_ai_re


def _bim_ai_normalize(value, depth=0):
    if depth > 16:
        raise ValueError("Routine result exceeds the maximum nesting depth")
    if value is None or isinstance(value, (str, bool, int)):
        return value
    if isinstance(value, float):
        if not _bim_ai_math.isfinite(value):
            raise ValueError("Routine result contains a non-finite number")
        return value
    if isinstance(value, dict):
        normalized = {}
        for key, item in value.items():
            if not isinstance(key, str):
                raise TypeError("Routine result object keys must be strings")
            normalized[key] = _bim_ai_normalize(item, depth + 1)
        return normalized
    if isinstance(value, (list, tuple)):
        return [_bim_ai_normalize(item, depth + 1) for item in value]
    raise TypeError("OUT must contain only JSON-compatible values")


_bim_ai_run_id = globals().get("_BIM_AI_RUN_ID") or _bim_ai_os.environ.get("BIM_AI_RUN_ID", "")
_bim_ai_result_path = globals().get("_BIM_AI_RESULT_PATH") or _bim_ai_os.environ.get("BIM_AI_RESULT_PATH", "")
if not _bim_ai_re.fullmatch(r"[0-9a-f]{32}", _bim_ai_run_id):
    raise ValueError("Missing or invalid runner correlation id")
if not _bim_ai_os.path.isabs(_bim_ai_result_path) or not _bim_ai_result_path.lower().endswith(".json"):
    raise ValueError("Missing or invalid runner result path")

_bim_ai_value = _bim_ai_normalize(OUT)
_bim_ai_status = "ok"
if isinstance(_bim_ai_value, dict):
    _bim_ai_status = _bim_ai_value.get("status", "ok")
    if not isinstance(_bim_ai_status, str) or len(_bim_ai_status) > 80:
        raise ValueError("Routine result status must be a short string")
_bim_ai_payload = _bim_ai_json.dumps(
    {"status": _bim_ai_status, "routine_result": _bim_ai_value},
    ensure_ascii=False,
    allow_nan=False,
    separators=(",", ":"),
)
if len(_bim_ai_payload.encode("utf-8")) > 65536:
    raise ValueError("Routine result exceeds 64 KiB")

_bim_ai_temp_path = _bim_ai_result_path + ".tmp"
with open(_bim_ai_temp_path, "w", encoding="utf-8", newline="\n") as _bim_ai_file:
    _bim_ai_file.write(_bim_ai_payload)
_bim_ai_os.replace(_bim_ai_temp_path, _bim_ai_result_path)
# ----------------------------------------
